# Grasshopper definition 01_Pannello_forato_mesh_planare.gh (Grasshopper 1.0.8)
# plug-ins: Ant

pannello_con_foro = Brep(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)
linee_e_punti_da_pulire = Geometry([Line((0, 2, 0.005), (12, 2, 0.005)), Line((0, 4, 0.005), (12, 4, 0.005)), Point(9, 6, 0.006), Point(9, 6, 0.006)])
centro_refinement = Point(Point(3, 4, 0.004))
# 01 / PANNELLO FORATO - DALLE GEOMETRIE ALLA MESH
# Ant 1.1.2 | Rhino 8 Windows | Tutte le geometrie sono salvate in questo file.
# Premi Run su Planar Mesh. Poi modifica gli slider e premi di nuovo Run; KR abilita il ricalcolo continuo.
# 1. GEOMETRIA
# Pannello 12 x 8 con foro 2 x 2.
# Le linee e i punti sono leggermente fuori piano. Un punto e' duplicato.
# Vincoli bordo-bordo a y=2 e attraverso il foro a y=4. Clean Geometry proietta, taglia al foro e rimuove i duplicati.
kr_ricalcolo_continuo = BooleanToggle(False)
mt_merge = Slider(0.01, range=0.001..0.03)
pt_proiezione = Slider(0.02, range=0.001..0.05)
size_locale = Slider(0.25, range=0.1..1)
mr = MeshRefinement(Geometry=centro_refinement, Size=size_locale)
# 2. PULIZIA E REFINEMENT
# S / E / R di Clean Geometry vanno agli omonimi ingressi del meshatore.
# PT=0.02 recupera gli scarti dal piano. Size locale=0.25 infittisce vicino al punto.
# Attiva la preview di CG per vedere C arancione, D rosso e U viola.
cg = CleanGeometry(
    Surfaces=pannello_con_foro,
    Embedded=linee_e_punti_da_pulire,
    Refinements=mr,
    MergeTolerance=mt_merge,
    ProjectionTolerance=pt_proiezione,
    CurveTolerance=0.001,
    UnionCoplanarSurfaces=False)  # -> Surfaces, Embedded, Refinements, Log, Changed, Discarded, Unresolved
panel = Panel(cg.Log)
size_globale = Slider(1, range=0.5..2)
# 3. MESHATURA
# Premi il pulsante Run.
# L'esempio usa triangoli (Frontal-Delaunay), con Recombine e Transfinite disattivati.
# La tolleranza di PM conserva il significato storico del plugin: non e' PT.
pm = PlanarMesh(
    Surfaces=cg.Surfaces,
    Embedded=cg.Embedded,
    Refinements=cg.Refinements,
    MeshAlgorithm=6,
    Recombine=False,
    RecombineAlgorithm=2,
    Transfinite=False,
    Refine=False,
    Size=size_globale,
    Tolerance=0.1,
    KeepRunning=kr_ricalcolo_continuo,
    Ant_UseTasks=False)  # -> Mesh, Report
panel_2 = Panel(pm.Report)
cmm = CleanAndMergeMesh(Meshes=pm.Mesh, VertexTolerance=0.001, MinimumEdgeLength=0, MinimumFaceArea=0)  # -> Mesh, Report, Changed, Discarded, Unresolved
# 4. RISULTATO
# Clean and Merge Mesh unisce i nodi coincidenti. EL=0 e FA=0 preservano gli elementi sani.
# Il foro deve restare aperto. Mesh Topology espone i bordi esterni e quelli del foro.
mt = MeshTopology(Mesh=cmm.Mesh)  # -> Vertices, FaceVertices, TopologyVertices, Edges, EdgeVertices, EdgeFaces, NakedEdges, NonManifoldEdges, BoundaryLoops, Report
panel_3 = Panel(mt.Report)
