# Grasshopper definition 02_Pulizia_qualita_e_parti.gh (Grasshopper 1.0.8)
# plug-ins: Ant

# 02 / PULIZIA, QUALITA' E GESTIONE DELLE PARTI
# Ant 1.1.2 | Ricalcolo automatico | Geometrie gia' incluse.
# Due pannelli hanno una fessura di 0.0005; ci sono una faccia duplicata, una degenere, un triangolo minuscolo e uno molto allungato.
# 1. RIPARA
# VT=0.001 salda la fessura tra i pannelli. FA=0.0001 elimina il triangolo minuscolo.
# EL=0 disattiva il collasso degli spigoli.
# Gli input sono nascosti: attiva la loro preview per confrontarli.
mesh_con_difetti = Mesh([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])
vt_vertici = Slider(0.001, range=0..0.003)
# 3. SEPARA, ORIENTA, TRIANGOLA
# Mesh Parts ordina per area: il pannello grande viene prima.
# Ogni parte ha un ramo e le mappe agli indici originali.
# Le superfici aperte non hanno un 'esterno': Normals uniforma le facce; Flip sceglie il verso.
fa_area_minima = Slider(0.0001, range=0..0.05)
cmm = CleanAndMergeMesh(Meshes=mesh_con_difetti, VertexTolerance=vt_vertici, MinimumEdgeLength=0, MinimumFaceArea=fa_area_minima)  # -> Mesh, Report, Changed, Discarded, Unresolved
panel = Panel(cmm.Report)
# 2. CONTROLLA E SELEZIONA
# Mesh Quality segnala il triangolo allungato.
# Collega F a Extract Mesh Faces: S contiene i difetti, R il resto.
# ER misura il rapporto tra lo spigolo piu' lungo e il piu' corto.
mq = MeshQuality(Mesh=cmm.Mesh, MaximumEdgeRatio=10, MinimumAngle=10, MaximumWarpage=0.001)  # -> Areas, EdgeRatios, MinimumAngles, Warpage, FlaggedFaceIndices, FlaggedGeometry, Report
mp = MeshParts(Mesh=cmm.Mesh, LargestFirst=True)  # -> Parts, SourceFaces, SourceVertices, Areas, Report
panel_2 = Panel(mp.Report)
# PREVIEW
# Di default vedi CMM e la diagnostica: arancione=modificato, rosso=scartato, viola=irrisolto.
# Per isolare il risultato di un altro componente, spegni la preview di CMM e attiva quella desiderata.
mt = MeshTopology(Mesh=cmm.Mesh)  # -> Vertices, FaceVertices, TopologyVertices, Edges, EdgeVertices, EdgeFaces, NakedEdges, NonManifoldEdges, BoundaryLoops, Report
mn = OrientMeshNormals(Mesh=mp.Parts, Outward=True, Flip=False)  # -> Mesh, FaceNormals, Report
panel_3 = Panel(mt.Report)
mef = ExtractMeshFaces(Mesh=cmm.Mesh, FaceIndices=mq.FlaggedFaceIndices, Invert=False)  # -> Selected, Remainder, SelectedSourceFaces, RemainderSourceFaces, SelectedSourceVertices, RemainderSourceVertices, Report
panel_4 = Panel(mq.Report)
panel_5 = Panel(mef.Report)
mtr = TriangulateMesh(Mesh=mn.Mesh)  # -> Mesh, SourceFaces, Report
panel_6 = Panel(mtr.Report)
