# Grasshopper definition 03_Matching_e_selezione.gh (Grasshopper 1.0.8)
# plug-ins: Ant

# 03 / MATCHING DI NODI E FACCE + ESTRAZIONE
# Ant 1.1.2 | Un'unica mesh, due isole | Gli indici delle facce valgono solo per questa mesh.
# Confronta le uscite M, V/F, D e OK. Lo stesso punto puo' appartenere a una faccia senza essere vicino a un vertice.
mesh_di_ricerca = Mesh(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)
punti_di_prova = Point([Point(0.1, 0.1, 0.01), Point(1.2, 1.3, 0.05), Point(10, 0, 0), Point(8, 7, 0)])
# PUNTI IN ORDINE
# 0: vicino a un nodo e alla faccia.
# 1: interno a una faccia, lontano dai nodi.
# 2: nodo esatto della seconda isola.
# 3: lontano da tutte le mesh.
# Con D=0.20, MMN trova 0 e 2; MMF trova 0, 1 e 2.
d_distanza_massima = Slider(0.2, range=0..1)
# NODI / RTree
# V contiene gli indici dei vertici originali.
# Distanze entro il limite, incluso il bordo.
# Un punto non trovato restituisce -1 e OK=False.
# FACCE / PUNTO PIU' VICINO
# F contiene gli indici delle facce, non dei baricentri.
# I punti di uscita sono proiettati sulla mesh.
mmn = MatchMeshNodes(Meshes=mesh_di_ricerca, Points=punti_di_prova, MaximumDistance=d_distanza_massima)  # -> MeshIndices, ElementIndices, ClosestPoints, Distances, Matched, Report
mmf = MatchMeshFaces(Meshes=mesh_di_ricerca, Points=punti_di_prova, MaximumDistance=d_distanza_massima)  # -> MeshIndices, ElementIndices, ClosestPoints, Distances, Matched, Report
panel = Panel(mmf.Report)
panel_2 = Panel(mmn.ElementIndices)
panel_3 = Panel(mmf.ElementIndices)
panel_4 = Panel(mmn.Report)
# FILTRA PRIMA DI ESTRARRE
# Dispatch riceve F come lista e OK come pattern.
# A contiene solo gli indici trovati: cosi' -1 non arriva a Extract Mesh Faces.
# Gli indici duplicati selezionano la faccia una sola volta. Attiva la preview di Extract per isolare le facce.
panel_5 = Panel(mmf.Matched)
dispatch = Dispatch(List=mmf.ElementIndices, DispatchPattern=mmf.Matched)  # -> ListA, ListB
mef = ExtractMeshFaces(Mesh=mesh_di_ricerca, FaceIndices=dispatch.ListA, Invert=False)  # -> Selected, Remainder, SelectedSourceFaces, RemainderSourceFaces, SelectedSourceVertices, RemainderSourceVertices, Report
panel_6 = Panel(mef.Report)
